# Grasshopper definition GISForGenerativeDesign.gh (Grasshopper 1.0.7)
# plug-ins: Weaverbird, GHopperGIS

rungdal = RunGDALAndOGR()
panel = Panel("D:\SSS\PerformanceNetwork\Data\Terrain.tif")
panel_2 = Panel("""4.576913
-73.815072""")
panel_3 = Panel("""4.570606
-73.826198""")
item = ListItem(List=panel_2, Index=0, Wrap=True)  # -> Item, Item1
item_2 = ListItem(List=panel_3, Index=0, Wrap=True)  # -> Item, Item1
dom²num = ConstructDomain²(UMin=item_2.Item, UMax=item_2.Item1, VMin=item.Item, VMax=item.Item1)
gate = StreamGate(Stream=panel, Gate=Toggle(False))  # -> Target0, Target1
gettopo = DownloadTopography(OutputPaths=gate.Target1, _2DDomain=dom²num, DataSource=1)
gate_2 = StreamGate(Stream=panel, Gate=Toggle(False))  # -> Target0, Target1
get_rast_coords = GetCoordinatesFromRasterFile(PathToFile=gate_2.Target1)  # -> Latitude, Longitude, UCount, VCount, Projection
read_rast = ReadRasterFileInfo(PathToFile=gate_2.Target1)  # -> DataSet, CacheSize
bnd = Bounds(Numbers=read_rast.DataSet)
dedomain = DeconstructDomain(Domain=bnd)  # -> Start, End
subtraction = Subtraction(A=read_rast.DataSet, B=dedomain.Start)
prjcoords = ReprojectFromCoords(
    XCoordinate=get_rast_coords.Latitude,
    YCoordinate=get_rast_coords.Longitude,
    ZCoordinate=subtraction,
    InputEPSG=Slider(4326, range=0..10000),
    OutputEPSG=Slider(3116, range=0..10000))
ptmesh = MeshFromPoints(GridOfPoints=prjcoords, UParameter=get_rast_coords.UCount, VParameter=get_rast_coords.VCount)
bbox = BoundingBox(Content=ptmesh, Plane=PlaneXY(0, 0, 0), UnionBox=True)  # -> Box, Box_2
worldori = TranslateToWorldOrigin(BboxIn=bbox.Box, GeometryIn=ptmesh, UseTasks=False)  # -> GeometryOut, InverseTransform
demesh = DeconstructMesh(Mesh=worldori.GeometryOut)  # -> Vertices, Faces, Colours, Normals
gate_3 = StreamGate(Stream=demesh.Vertices, Gate=Toggle(False))  # -> Target0, Target1
U = Integer(get_rast_coords.UCount)
V = Integer(get_rast_coords.VCount)
subdpt = SubdividePointGrid(PointsIn=gate_3.Target1, UParameter=U, VParameter=V, Iterations=Slider(4, range=0..10), Parallel=Toggle(True))  # -> PointsOut, UOut, VOut
ptmesh_2 = MeshFromPoints(GridOfPoints=subdpt.PointsOut, UParameter=subdpt.UOut, VParameter=subdpt.VOut, Triangles=Toggle(True))
gate_4 = StreamGate(Stream=ptmesh_2, Gate=Toggle(False))  # -> Target0, Target1
wblaplace = WeaverbirdsLaplacianSmoothing(MeshCurves=gate_4.Target1, Level=Slider(5, range=0..10), SmoothNakedEdges=0, Thin=1)
number_slider = Slider(1, range=0..1)  # disabled
number_slider_2 = Slider(5442, range=0..10000)  # disabled
mshrnd = RandomPointsFromMesh(MeshIn=wblaplace, Probability=number_slider, UParameter=subdpt.UOut, VParameter=subdpt.VOut, Seed=number_slider_2)  # -> Points, UParameter, VParameter; disabled
number_slider_3 = Slider(1, range=0..1)  # disabled
number_slider_4 = Slider(1, range=0..1)  # disabled
number_slider_5 = Slider(1, range=0..1)  # disabled
toggle = BooleanToggle(False)  # disabled
toggle_2 = BooleanToggle(True)  # disabled
zmbero = ZombieErosion(
    MeshIn=wblaplace,
    URandomParameterList=mshrnd.UParameter,
    VRandomParameterList=mshrnd.VParameter,
    UParameter=subdpt.UOut,
    VParameter=subdpt.VOut,
    Sediment=number_slider_5,
    Erosion=number_slider_3,
    Deposition=number_slider_4,
    FlowLines=toggle,
    ParallelComputation=toggle_2)  # -> ErodedMesh, FlowLines; disabled
lvero = LiveErosion(
    Run=Toggle(False),
    Reset=Button(),
    MeshIn=wblaplace,
    UParameter=subdpt.UOut,
    VParameter=subdpt.VOut,
    Sediment=Slider(0.092522, range=0..10),
    Erosion=Slider(0.727624, range=1e-06..1),
    Deposition=Slider(0.824, range=0..1),
    Visualize=Toggle(True),
    ParticlesPerIteration=Slider(2000, range=0..2000),
    RandomSeed=Slider(2695, range=0..10000),
    MaximumIterations=Slider(500, range=0..1000),
    ParallelComputation=Toggle(True))  # -> ErodedMesh, NumberOfIterations, FlowLines
multiplication = Multiplication(A=subdpt.UOut, B=subdpt.VOut)
mesh = Mesh(wblaplace)
mesh_2 = Mesh(wblaplace)  # disabled
subtraction_2 = Subtraction(A=multiplication, B=1)
item_3 = ListItem(List=subdpt.PointsOut, Index=0, Wrap=True)
item_4 = ListItem(List=subdpt.PointsOut, Index=subtraction_2, Wrap=True)
gate_5 = StreamGate(Stream=lvero.ErodedMesh, Gate=Toggle(False))  # -> Target0, Target1
rec_2pt = Rectangle2Pt(Plane=PlaneXY(0, 0, 0), PointA=item_3, PointB=item_4, Radius=0)  # -> Rectangle, Length
genes = GenePool(Decimals=4, Maximum=1, Minimum=0, Value=[0.8669, 0.3816])
boundary = BoundarySurfaces(Edges=rec_2pt.Rectangle, UseTasks=False)
genes_2 = GenePool(Decimals=4, Maximum=1, Minimum=0, Value=[0.1704, 0.5396])
item_5 = ListItem(List=genes, Index=0, Wrap=True)  # -> Item, Item1
wblaplace_2 = WeaverbirdsLaplacianSmoothing(MeshCurves=gate_5.Target1, Level=Slider(1, range=0..10), SmoothNakedEdges=0, Thin=1)
pt = ConstructPoint(XCoordinate=item_5.Item, YCoordinate=item_5.Item1, ZCoordinate=0)
item_6 = ListItem(List=genes_2, Index=0, Wrap=True)  # -> Item, Item1
evalsrf = EvaluateSurface(Surface=reparameterize(boundary), Point=pt)  # -> Point, Normal, UDirection, VDirection, Frame
pt_2 = ConstructPoint(XCoordinate=item_6.Item, YCoordinate=item_6.Item1, ZCoordinate=0)
gate_6 = StreamGate(Stream=wblaplace, Gate=Toggle(False))  # -> Target0, Target1
evalsrf_2 = EvaluateSurface(Surface=reparameterize(boundary), Point=pt_2)  # -> Point, Normal, UDirection, VDirection, Frame
number_slider_6 = Slider(4341, range=0..10000)
demesh_2 = DeconstructMesh(Mesh=wblaplace_2)  # -> Vertices, Faces, Colours, Normals
mesh_3 = Mesh(wblaplace_2)
Z = UnitZ(Factor=1)
dprod = DotProduct(VectorA=Z, VectorB=demesh_2.Normals, Unitize=False)
demesh_3 = DeconstructMesh(Mesh=gate_6.Target1)  # -> Vertices, Faces, Colours, Normals
medges = MeshEdges(Mesh=wblaplace_2)  # -> NakedEdges, InteriorEdges, NonManifoldEdges
mesh_4 = Mesh(gate_6.Target1)
bnd_2 = Bounds(Numbers=dprod)
cps = ClosestPoints(Point=evalsrf.Point, Cloud=demesh_2.Vertices, Count=number_slider_6)  # -> ClosestPoint, CPIndex, Distance
project = Project(Geometry=medges.InteriorEdges, Plane=PlaneXY(0, 0, 0))  # -> Geometry, Transform
Z_2 = UnitZ(Factor=1)
dedomain_2 = DeconstructDomain(Domain=bnd_2)  # -> Start, End
dprod_2 = DotProduct(VectorA=Z_2, VectorB=demesh_3.Normals, Unitize=False)
item_7 = ListItem(List=demesh_2.Normals, Index=cps.CPIndex, Wrap=True)
gradient = Gradient(
    LowerLimit=dedomain_2.Start,
    UpperLimit=dedomain_2.End,
    Parameter=dprod,
    stops=[0: RGB(234, 38, 0), 0.25: RGB(234, 126, 0), 0.5: RGB(254, 244, 84), 0.75: RGB(173, 203, 249), 1: RGB(75, 107, 169)])
cps_2 = ClosestPoints(Point=evalsrf_2.Point, Cloud=demesh_3.Vertices, Count=number_slider_6)  # -> ClosestPoint, CPIndex, Distance
bnd_3 = Bounds(Numbers=dprod_2)
vdis = VectorDisplay(Anchor=cps.ClosestPoint, Vector=item_7)
dprod_3 = DotProduct(VectorA=Z, VectorB=item_7, Unitize=False)
dedomain_3 = DeconstructDomain(Domain=bnd_3)  # -> Start, End
item_8 = ListItem(List=demesh_3.Normals, Index=cps_2.CPIndex, Wrap=True)
Z_3 = UnitZ(Factor=1)
lng = ListLength(List=dprod_3)
ma = MassAddition(Input=dprod_3)  # -> Result, PartialResults
gradient_2 = Gradient(
    LowerLimit=dedomain_3.Start,
    UpperLimit=dedomain_3.End,
    Parameter=dprod_2,
    stops=[0: RGB(234, 38, 0), 0.25: RGB(234, 126, 0), 0.5: RGB(254, 244, 84), 0.75: RGB(173, 203, 249), 1: RGB(75, 107, 169)])
vdis_2 = VectorDisplay(Anchor=cps_2.ClosestPoint, Vector=item_8)
mcol = MeshColours(Mesh=wblaplace_2, Colours=gradient)
dprod_4 = DotProduct(VectorA=Z_3, VectorB=item_8, Unitize=False)
division = Division(A=ma.Result, B=lng)
galapagos = Galapagos(fitness=division, gene=genes)
lng_2 = ListLength(List=dprod_4)
ma_2 = MassAddition(Input=dprod_4)  # -> Result, PartialResults
panel_4 = Panel(division)
division_2 = Division(A=ma_2.Result, B=lng_2)
galapagos_2 = Galapagos(fitness=division_2, gene=genes_2)
mcol_2 = MeshColours(Mesh=gate_6.Target1, Colours=gradient_2)
panel_5 = Panel(division_2)
