# Grasshopper definition GISForGenerativeDesign_1.gh (Grasshopper 1.0.7)
# plug-ins: GHopperGIS

number_slider = Slider(3116, range=0..10000)
rungdal = RunGDALAndOGR()
number_slider_2 = Slider(116.76, range=0..360)
open = OpenFile(Run=Toggle(False))
txt = Text("D:\SSS\GHopperGIS\GrasshopperScripts\Data\Vector\Constructions\Constructions.shp")
open_2 = OpenFile(Run=Toggle(False))
txt_2 = Text("D:\SSS\GHopperGIS\GrasshopperScripts\Data\Vector\RoadMesh\RoadMesh.shp")
open_3 = OpenFile(Run=Toggle(False))
open_4 = OpenFile(Run=Toggle(False))
txt_3 = Text("D:\SSS\GHopperGIS\GrasshopperScripts\Data\Vector\Terrain\TerrainCurves.shp")
txt_4 = Text("D:\SSS\GHopperGIS\GrasshopperScripts\Data\Vector\Blocks\Blocks.shp")
panel = Panel(txt)
panel_2 = Panel(txt_2)
panel_3 = Panel(txt_3)
panel_4 = Panel(txt_4)
vec_extr = VectorExtractor(PathToFile=open_4, FieldToSelect=Slider(2, range=0..10))  # -> NumberOfFeatures, Layers, Fields, OutputField, GeometryType, Projection
vec_extr_2 = VectorExtractor(PathToFile=open_2, FieldToSelect=Slider(1, range=0..1))  # -> NumberOfFeatures, Layers, Fields, OutputField, GeometryType, Projection
read_vec = ReadVector(PathToFile=open, OutputEPSGCode=number_slider)  # -> GeometryOutput, CullPattern
read_vec_2 = ReadVector(PathToFile=open_2, OutputEPSGCode=number_slider)  # -> GeometryOutput, CullPattern
read_vec_3 = ReadVector(PathToFile=open_3, OutputEPSGCode=number_slider)  # -> GeometryOutput, CullPattern
read_vec_4 = ReadVector(PathToFile=open_4, OutputEPSGCode=number_slider)  # -> GeometryOutput, CullPattern
panel_5 = Panel(vec_extr.Fields)
panel_6 = Panel(vec_extr_2.Fields)
bnd = Bounds(Numbers=vec_extr.OutputField)
flatten = FlattenTree(Tree=read_vec.GeometryOutput, Path="{0}")
flatten_2 = FlattenTree(Tree=read_vec.CullPattern, Path="{0}")
flatten_3 = FlattenTree(Tree=read_vec_3.GeometryOutput, Path="{0}")
flatten_4 = FlattenTree(Tree=read_vec_3.CullPattern, Path="{0}")
flatten_5 = FlattenTree(Tree=read_vec_2.GeometryOutput, Path="{0}")
flatten_6 = FlattenTree(Tree=read_vec_2.CullPattern, Path="{0}")
vec_ext = VectorExtents(PathToFile=open_4)  # -> MinimumX, MinimumY, MaximumX, MaximumY
dedomain = DeconstructDomain(Domain=bnd)  # -> Start, End
multiplication = Multiplication(A=vec_extr_2.OutputField, B=Slider(3.7, range=0..10))
cull = CullPattern(List=flatten, CullPattern=flatten_2)
cull_2 = CullPattern(List=flatten_3, CullPattern=flatten_4)
subtraction = Subtraction(A=vec_extr.OutputField, B=dedomain.Start)
cull_3 = CullPattern(List=flatten_5, CullPattern=flatten_6)
flatten_7 = FlattenTree(Tree=read_vec_4.GeometryOutput, Path="{0}")
flatten_8 = FlattenTree(Tree=read_vec_4.CullPattern, Path="{0}")
cull_4 = CullPattern(List=multiplication, CullPattern=flatten_6)
prjcoords = ReprojectFromCoords(XCoordinate=vec_ext.MinimumX, YCoordinate=vec_ext.MinimumY, InputEPSG=vec_extr.Projection, OutputEPSG=number_slider)
prjcoords_2 = ReprojectFromCoords(XCoordinate=vec_ext.MaximumX, YCoordinate=vec_ext.MaximumY, InputEPSG=vec_extr.Projection, OutputEPSG=number_slider)
cull_5 = CullPattern(List=subtraction, CullPattern=flatten_8)
cull_6 = CullPattern(List=flatten_7, CullPattern=flatten_8)
graft = GraftTree(Tree=cull_4, IncludeEmptyLists=True, IncludeNullItems=True)
rec_2pt = Rectangle2Pt(Plane=PlaneXY(0, 0, 0), PointA=prjcoords, PointB=prjcoords_2, Radius=0)  # -> Rectangle, Length
worldori = TranslateToWorldOrigin(BboxIn=rec_2pt.Rectangle, GeometryIn=cull, Rotation=degrees(number_slider_2), UseTasks=False)  # -> GeometryOut, InverseTransform
worldori_2 = TranslateToWorldOrigin(BboxIn=rec_2pt.Rectangle, GeometryIn=cull_2, Rotation=degrees(number_slider_2), UseTasks=False)  # -> GeometryOut, InverseTransform
worldori_3 = TranslateToWorldOrigin(BboxIn=rec_2pt.Rectangle, GeometryIn=cull_3, Rotation=degrees(number_slider_2), UseTasks=False)  # -> GeometryOut, InverseTransform
simplify = SimplifyTree(Tree=graft, Front=False)
graft_2 = GraftTree(Tree=worldori_2.GeometryOut, IncludeEmptyLists=True, IncludeNullItems=True)
number_slider_3 = Slider(54.263, range=0..100)
graft_3 = GraftTree(Tree=worldori.GeometryOut, IncludeEmptyLists=True, IncludeNullItems=True)
Z = UnitZ(Factor=simplify)
worldori_4 = TranslateToWorldOrigin(BboxIn=rec_2pt.Rectangle, GeometryIn=cull_6, Rotation=degrees(number_slider_2), UseTasks=False)  # -> GeometryOut, InverseTransform
simplify_2 = SimplifyTree(Tree=graft_2, Front=False)
pt = Point(Point(-20.15338514, 8.196963408, 0))
graft_4 = GraftTree(Tree=worldori_3.GeometryOut, IncludeEmptyLists=True, IncludeNullItems=True)
simplify_3 = SimplifyTree(Tree=graft_3, Front=False)
number_slider_4 = Slider(-300, range=-1000..-300)
c_script = CSharpScript(geoIn=worldori_2.GeometryOut, pt=pt, dist=number_slider_3)  # -> out, A, B, C; inputs geoIn: list of Curve, pt: Point3d, dist: Double
# ---------- c_script: C# ----------
    List<Curve> culledCurves = new List<Curve>();
    List<int> idxs = new List<int>();
    List<bool> bools = new List<bool>();

    for( int i = 0; i < geoIn.Count; ++i )
    {

      Point3d centers = AreaMassProperties.Compute(geoIn[i]).Centroid;

      if( pt.DistanceTo(centers) < dist )
      {

        culledCurves.Add(geoIn[i]);
        idxs.Add(i);
        bools.Add(true);

      }
      
      else
      {
      
        bools.Add(false);
      
      }

    }

    A = culledCurves;
    B = idxs;
    C = bools;
# ---------- end c_script ----------
disc = Discontinuity(Curve=simplify_2, Level=1)  # -> simplify(Points), Parameters
c_script_2 = CSharpScript(geoIn=worldori_3.GeometryOut, pt=pt, dist=number_slider_3)  # -> out, A, B, C; inputs geoIn: list of Curve, pt: Point3d, dist: Double; same code as c_script
number_slider_5 = Slider(-300, range=-1000..-300)
simplify_4 = SimplifyTree(Tree=graft_4, Front=False)
disc_2 = Discontinuity(Curve=simplify_3, Level=1)  # -> simplify(Points), Parameters
item = ListItem(List=worldori_4.InverseTransform, Index=0, Wrap=True)
Z_2 = UnitZ(Factor=cull_5)
number_slider_6 = Slider(-300, range=-1000..-300)
panel_7 = Panel(c_script.C)
panel_8 = Panel(c_script_2.C)
Z_3 = UnitZ(Factor=number_slider_4)
inverse = InverseTransform(Transform=item)
area = Area(Geometry=simplify_4, UseTasks=True)  # -> Area, Centroid
Z_4 = UnitZ(Factor=number_slider_5)
move = Move(Geometry=worldori_4.GeometryOut, Motion=Z_2)  # -> Geometry, Transform
move_2 = Move(Geometry=disc.Points, Motion=Z_3)  # -> Geometry, Transform
multiplication_2 = Multiplication(A=number_slider_4, B=-2)
cull_7 = CullPattern(List=worldori_2.GeometryOut, CullPattern=invert(c_script.C))
cull_8 = CullPattern(List=worldori_3.GeometryOut, CullPattern=invert(c_script_2.C))
Z_5 = UnitZ(Factor=number_slider_6)
move_3 = Move(Geometry=disc_2.Points, Motion=Z_4)  # -> Geometry, Transform
multiplication_3 = Multiplication(A=number_slider_5, B=-2)
transform = Transform(Geometry=rec_2pt.Rectangle, Transform=inverse)
patch = Patch(Curves=move.Geometry, Spans=20, Flexibility=1, Trim=True)
Z_6 = UnitZ(Factor=multiplication_2)
move_4 = Move(Geometry=area.Centroid, Motion=Z_5)  # -> Geometry, Transform
multiplication_4 = Multiplication(A=number_slider_6, B=-2)
Z_7 = UnitZ(Factor=multiplication_3)
move_5 = Move(Geometry=move_2.Geometry, Motion=Z_6)  # -> Geometry, Transform
move_6 = Move(Geometry=move_3.Geometry, Motion=Z_7)  # -> Geometry, Transform
number_slider_7 = Slider(-200, range=-1000..-200)
Z_8 = UnitZ(Factor=multiplication_4)
ln = Line(StartPoint=move_2.Geometry, EndPoint=move_5.Geometry)  # -> simplify(Line)
move_7 = Move(Geometry=move_4.Geometry, Motion=Z_8)  # -> Geometry, Transform
ln_2 = Line(StartPoint=move_3.Geometry, EndPoint=move_6.Geometry)  # -> simplify(Line)
slx = SurfaceLine(Surface=patch, Line=ln, LimitToFirst=False)  # -> Curves, simplify(Points), UVPoints, Normal
Z_9 = UnitZ(Factor=number_slider_7)
ln_3 = Line(StartPoint=move_4.Geometry, EndPoint=move_7.Geometry)
slx_2 = SurfaceLine(Surface=patch, Line=ln_2, LimitToFirst=False)  # -> Curves, simplify(Points), UVPoints, Normal
multiplication_5 = Multiplication(A=number_slider_7, B=-2)
move_8 = Move(Geometry=transform, Motion=Z_9)  # -> Geometry, Transform
path_mapper = PathMapper(slx.Points, source="{A;B}", target="{A}")
slx_3 = SurfaceLine(Surface=patch, Line=ln_3, LimitToFirst=False)  # -> Curves, simplify(Points), UVPoints, Normal
path_mapper_2 = PathMapper(slx_2.Points, source="{A;B}", target="{A}")
Z_10 = UnitZ(Factor=multiplication_5)
move_9 = Move(Geometry=transform, Motion=Z_10)  # -> Geometry, Transform
subtraction_2 = Subtraction(A=path_mapper, B=disc.Points)
subtraction_3 = Subtraction(A=path_mapper_2, B=disc_2.Points)
subtraction_4 = Subtraction(A=slx_3.Points, B=area.Centroid)
loft = Loft(
    Curves=[move_9.Geometry, move_8.Geometry],
    Options={Adjust=False, Closed=False, LoftEnds=0, LoftSimp=0, LoftType=0, Rebuild=10, Refit=0.01})
Z_11 = UnitZ(Factor=subtraction_2)
number_slider_8 = Slider(1, range=0..1)
Z_12 = UnitZ(Factor=subtraction_3)
Z_13 = UnitZ(Factor=subtraction_4)
number_slider_9 = Slider(4, range=0..10)
move_10 = Move(Geometry=disc.Points, Motion=Z_11)  # -> Geometry, Transform
move_11 = Move(Geometry=disc_2.Points, Motion=Z_12)  # -> Geometry, Transform
split = SplitBrep(Brep=patch, Cutter=loft)
move_12 = Move(Geometry=simplify_4, Motion=Z_13)  # -> Geometry, Transform
dom = ConstructDomain(DomainStart=0, DomainEnd=1)
pline = PolyLine(Vertices=move_10.Geometry, Closed=True)
boundary = BoundarySurfaces(Edges=move_12.Geometry)
pline_2 = PolyLine(Vertices=move_11.Geometry, Closed=False)
item_2 = ListItem(List=split, Index=Slider(1, range=0..1), Wrap=True)
c_script_3 = CSharpScript(
    genelist="GenePoolY",
    count=number_slider_9,
    domain=dom,
    randomize=Button(),
    randomPercentage=number_slider_8,
    Reference="C:\Program Files\Rhino 6\Plug-ins\Grasshopper\Components\GalapagosComponents.gha")  # -> out, A; inputs genelist: String, count: Int32, randomize: Boolean, randomPercentage: Double
# ---------- c_script_3: C# ----------
    GalapagosComponents.GalapagosGeneListObject GComp = null;

    GH_Document ghDocument = Component.OnPingDocument();

    if (ghDocument != null)
    {

      foreach (IGH_DocumentObject obj in ghDocument.Objects)
      {

        if (obj.ToString() == "GalapagosComponents.GalapagosGeneListObject")
        {

          if (obj.NickName == genelist)
          {
            GComp = (GalapagosComponents.GalapagosGeneListObject) obj;
          }

        }

      }
      if (GComp == null)
      {
        Print( "GenePool has not been found!" );
        return;
      }

      else
      {

        Print( "GenePool found!" );

      }

      GComp.Count = count;

      GComp.RemapToNewLimits(Convert.ToDecimal(domain.T0), Convert.ToDecimal(domain.T1));

      if( randomize )
      {
        GComp.Randomize(randomPercentage);

      }

      GComp.ExpireSolution(true);


    }

    else
    {

      Print( "No GH_Document" );

    }
# ---------- end c_script_3 ----------
c_script_4 = CSharpScript(
    genelist="GenePoolX",
    count=number_slider_9,
    domain=dom,
    randomize=Button(),
    randomPercentage=number_slider_8,
    Reference="C:\Program Files\Rhino 6\Plug-ins\Grasshopper\Components\GalapagosComponents.gha")  # -> out, A; inputs genelist: String, count: Int32, randomize: Boolean, randomPercentage: Double; same code as c_script_3
flatten_9 = FlattenTree(Tree=pline, Path="{0}")
number_slider_10 = Slider(1, range=0..1)
extr = Extrude(Base=boundary, Direction=Z)
flatten_10 = FlattenTree(Tree=extr, Path="{0}")
dom_2 = ConstructDomain(DomainStart=Slider(9.25, range=0..100), DomainEnd=Slider(27.996, range=0..100))
cull_9 = CullPattern(List=flatten_9, CullPattern=invert(c_script.C))
cull_10 = CullPattern(List=flatten_9, CullPattern=c_script.C)
cull_11 = CullPattern(List=flatten_10, CullPattern=invert(c_script_2.C))
genepooly = GenePool(Decimals=2, Maximum=1, Minimum=0, Value=[0.8, 0.54, 0.19, 0.19])
genepoolx = GenePool(Decimals=2, Maximum=1, Minimum=0, Value=[0.29, 0.47, 0.22, 0.6])
patch_2 = Patch(Curves=cull_10, Spans=20, Flexibility=1, Trim=True)
c_script_5 = CSharpScript(
    genelist="GenePoolRectY",
    count=number_slider_9,
    domain=dom_2,
    randomize=Button(),
    randomPercentage=number_slider_10,
    Reference="C:\Program Files\Rhino 6\Plug-ins\Grasshopper\Components\GalapagosComponents.gha")  # -> out, A; inputs genelist: String, count: Int32, randomize: Boolean, randomPercentage: Double; same code as c_script_3
c_script_6 = CSharpScript(
    genelist="GenePoolRectX",
    count=number_slider_9,
    domain=dom_2,
    randomize=Button(),
    randomPercentage=number_slider_10,
    Reference="C:\Program Files\Rhino 6\Plug-ins\Grasshopper\Components\GalapagosComponents.gha")  # -> out, A; inputs genelist: String, count: Int32, randomize: Boolean, randomPercentage: Double; same code as c_script_3
pt_2 = ConstructPoint(XCoordinate=genepoolx, YCoordinate=genepooly, ZCoordinate=0)
genepoolrecty = GenePool(Decimals=2, Maximum=27.996, Minimum=9.25, Value=[15.59864533, 13.7790336, 10.6596992, 22.94707733])
genepoolrectx = GenePool(Decimals=2, Maximum=27.996, Minimum=9.25, Value=[12.55929387, 9.259997867, 12.099392, 9.259997867])
evalsrf = EvaluateSurface(Surface=reparameterize(patch_2), Point=graft(pt_2))  # -> Point, Normal, UDirection, VDirection, Frame
srf_cp = SurfaceClosestPoint(Point=evalsrf.Point, Surface=patch_2)  # -> simplify(Point), UVPoint, Distance
multiplication_6 = Multiplication(A=simplify(graft(genepoolrectx)), B=0.5)
multiplication_7 = Multiplication(A=simplify(graft(genepoolrecty)), B=0.5)
multiplication_8 = Multiplication(A=multiplication_6, B=-1)
multiplication_9 = Multiplication(A=multiplication_7, B=-1)
dom_3 = ConstructDomain(DomainStart=multiplication_8, DomainEnd=multiplication_6)
dom_4 = ConstructDomain(DomainStart=multiplication_9, DomainEnd=multiplication_7)
dom_5 = ConstructDomain(DomainStart=Slider(114.9, range=0..1000), DomainEnd=Slider(228.5, range=0..1000))
rectangle = Rectangle(Plane=srf_cp.Point, XSize=dom_3, YSize=dom_4, Radius=0)  # -> Rectangle, Length
c_script_7 = CSharpScript(
    genelist="GenePoolAreas",
    count=Slider(4, range=0..10),
    domain=dom_5,
    randomize=Button(),
    randomPercentage=Slider(1, range=0..1),
    Reference="C:\Program Files\Rhino 6\Plug-ins\Grasshopper\Components\GalapagosComponents.gha")  # -> out, A; inputs genelist: String, count: Int32, randomize: Boolean, randomPercentage: Double; same code as c_script_3
crv = Curve(rectangle.Rectangle)
offset = OffsetCurve(Curve=rectangle.Rectangle, Distance=Slider(10, range=0..10), Plane=PlaneXY(0, 0, 0), Corners=1)
crv_2 = Curve(offset)
genepoolareas = GenePool(Decimals=2, Maximum=228.5, Minimum=114.9, Value=[195.9511249, 127.587039, 128.9732506, 212.5154168])
area_2 = Area(Geometry=rectangle.Rectangle)  # -> Area, Centroid
project = Project(Geometry=cull_10, Plane=PlaneXY(0, 0, 0))  # -> Geometry, Transform
project_2 = Project(Geometry=crv_2, Plane=PlaneXY(0, 0, 0))  # -> Geometry, Transform
crv_3 = Curve(project.Geometry)
crv_4 = Curve(simplify(project_2.Geometry))
flatten_11 = FlattenTree(Tree=[project_2.Geometry, project.Geometry], Path="{0}")
pt_3 = Point(simplify(graft([Point(198.1825539, -158.0822602, 0), Point(-98.40261521, -153.7539884, 0), Point(-144.3887069, 158.7085494, 0), Point(-8.762732448, 238.6448407, 0)])))  # disabled
crv_cp = CurveClosestPoint(Point=area_2.Centroid, Curve=crv_3)  # -> simplify(Point), Parameter, Distance; disabled
crvtopo = CurveTopology(CurvesIn=worldori.GeometryOut)  # disabled
project_3 = Project(Geometry=flatten_11, Plane=PlaneXY(0, 0, 0))  # -> Geometry, Transform
cvlicls = CurveListClosestPoint(PointIn=pt_3, CurveList=worldori.GeometryOut)  # -> ClosestCurve, Index; disabled
cvlicls_2 = CurveListClosestPoint(PointIn=crv_cp.Point, CurveList=worldori.GeometryOut)  # -> ClosestCurve, Index; disabled
expression = Expression(x=flatten(area_2.Area), y=genepoolareas, Expression="Abs( x - y )")
colmm = CollisionManyMany(Colliders=flatten(project_3.Geometry))  # -> Collision, Indices
ma = MassAddition(Input=colmm.Collision)  # -> Result, PartialResults
pfin = PathFinding(
    StartingPointsIndex=cvlicls.Index,
    FinishingPointsIndex=cvlicls_2.Index,
    TopologyTree=crvtopo,
    CurveList=worldori.GeometryOut)  # -> simplify(Path); disabled
panel_9 = Panel(colmm.Collision)
len = Length(Curve=pfin)  # disabled
panel_10 = Panel(expression)
panel_11 = Panel(len)  # disabled
flatten_12 = FlattenTree(Tree=len, Path="{0}")  # disabled
ma_2 = MassAddition(Input=flatten_12)  # -> Result, PartialResults; disabled
number_slider_11 = Slider(0.01, range=0..0.01)  # disabled
multiplication_10 = Multiplication(A=ma_2.Result, B=number_slider_11)  # disabled
multiplication_11 = Multiplication(A=ma.Result, B=Slider(200, range=0..1000))
ma_3 = MassAddition(Input=flatten([expression, multiplication_11]))  # -> Result, PartialResults
galapagos = Galapagos(fitness=ma_3, gene=[genepoolx, genepooly, genepoolrectx, genepoolrecty])
panel_12 = Panel(ma_3.Result)
