# Grasshopper definition GISWorkshop_1.gh (Grasshopper 1.0.7)
# plug-ins: GHopperGIS

# ---- group: Constants
number_slider = Slider(3116, range=0..10000)
number_slider_2 = Slider(118.29, range=0..360)
point = Point(Point(-25.10019702, -3.412142447, 0))
number_slider_3 = Slider(58.149, range=0..100)

# ----
openfile = OpenFile(Run=Toggle(False))
openfile_2 = OpenFile(Run=Toggle(False))
openfile_3 = OpenFile(Run=Toggle(False))
run_gdal_and_ogr = RunGDALAndOGR()
openfile_4 = OpenFile(Run=Toggle(False))
text = Text("D:\SSS\GHopperGIS\GrasshopperScripts\Data\Vector\RoadMesh\RoadMesh.shp")
text_2 = Text("D:\SSS\GHopperGIS\GrasshopperScripts\Data\Vector\Blocks\Blocks.shp")
text_3 = Text("D:\SSS\GHopperGIS\GrasshopperScripts\Data\Vector\Constructions\Constructions.shp")
text_4 = Text("D:\SSS\GHopperGIS\GrasshopperScripts\Data\Vector\Terrain\TerrainCurves.shp")
vector_extractor = VectorExtractor(PathToFile=openfile_3, FieldToSelect=Slider(2, range=0..10))  # -> NumberOfFeatures, Layers, Fields, OutputField, GeometryType, Projection
read_vector = ReadVector(PathToFile=openfile, OutputEPSGCode=number_slider)  # -> GeometryOutput, CullPattern
panel = Panel(text_3)
read_vector_2 = ReadVector(PathToFile=openfile_2, OutputEPSGCode=number_slider)  # -> GeometryOutput, CullPattern
panel_2 = Panel(text)
vector_extractor_2 = VectorExtractor(PathToFile=openfile, FieldToSelect=Slider(1, range=0..1))  # -> NumberOfFeatures, Layers, Fields, OutputField, GeometryType, Projection
read_vector_3 = ReadVector(PathToFile=openfile_3, OutputEPSGCode=number_slider)  # -> GeometryOutput, CullPattern
panel_3 = Panel(text_4)
read_vector_4 = ReadVector(PathToFile=openfile_4, OutputEPSGCode=number_slider)  # -> GeometryOutput, CullPattern
panel_4 = Panel(text_2)
panel_5 = Panel(vector_extractor.Projection)
flatten_tree = FlattenTree(Tree=read_vector.GeometryOutput, Path="{0}")
flatten_tree_2 = FlattenTree(Tree=read_vector_2.GeometryOutput, Path="{0}")
flatten_tree_3 = FlattenTree(Tree=read_vector.CullPattern, Path="{0}")
flatten_tree_4 = FlattenTree(Tree=read_vector_2.CullPattern, Path="{0}")
flatten_tree_5 = FlattenTree(Tree=read_vector_3.GeometryOutput, Path="{0}")
flatten_tree_6 = FlattenTree(Tree=read_vector_4.GeometryOutput, Path="{0}")
flatten_tree_7 = FlattenTree(Tree=read_vector_3.CullPattern, Path="{0}")
flatten_tree_8 = FlattenTree(Tree=read_vector_4.CullPattern, Path="{0}")
cull_pattern = CullPattern(List=vector_extractor_2.OutputField, CullPattern=flatten_tree_3)
cull_pattern_2 = CullPattern(List=flatten_tree, CullPattern=flatten_tree_3)
cull_pattern_3 = CullPattern(List=flatten_tree_2, CullPattern=flatten_tree_4)
cull_pattern_4 = CullPattern(List=vector_extractor.OutputField, CullPattern=flatten_tree_7)
cull_pattern_5 = CullPattern(List=flatten_tree_5, CullPattern=flatten_tree_7)
cull_pattern_6 = CullPattern(List=flatten_tree_6, CullPattern=flatten_tree_8)
vector_extents = VectorExtents(PathToFile=openfile_3)  # -> MinimumX, MinimumY, MaximumX, MaximumY
bounds = Bounds(Numbers=cull_pattern_4)
multiplication = Multiplication(A=cull_pattern, B=Slider(3.7, range=0..10))
deconstruct_domain = DeconstructDomain(Domain=bounds)  # -> Start, End
graft_tree = GraftTree(Tree=multiplication, IncludeEmptyLists=True, IncludeNullItems=True)
reproject_from_coords = ReprojectFromCoords(
    XCoordinate=vector_extents.MinimumX,
    YCoordinate=vector_extents.MinimumY,
    InputEPSG=vector_extractor.Projection,
    OutputEPSG=number_slider)
reproject_from_coords_2 = ReprojectFromCoords(
    XCoordinate=vector_extents.MaximumX,
    YCoordinate=vector_extents.MaximumY,
    InputEPSG=vector_extractor.Projection,
    OutputEPSG=number_slider)
simplify_tree = SimplifyTree(Tree=graft_tree, Front=False)
subtraction = Subtraction(A=cull_pattern_4, B=deconstruct_domain.Start)
rectangle_2pt = Rectangle2Pt(Plane=PlaneXY(0, 0, 0), PointA=reproject_from_coords, PointB=reproject_from_coords_2, Radius=0)  # -> Rectangle, Length
unit_z = UnitZ(Factor=subtraction)
bounds_2 = Bounds(Numbers=subtraction)
translate_to_world_origin = TranslateToWorldOrigin(BboxIn=rectangle_2pt.Rectangle, GeometryIn=cull_pattern_2, Rotation=degrees(number_slider_2))  # -> GeometryOut, InverseTransform
translate_to_world_origin_2 = TranslateToWorldOrigin(BboxIn=rectangle_2pt.Rectangle, GeometryIn=cull_pattern_3, Rotation=degrees(number_slider_2))  # -> GeometryOut, InverseTransform
translate_to_world_origin_3 = TranslateToWorldOrigin(BboxIn=rectangle_2pt.Rectangle, GeometryIn=cull_pattern_6, Rotation=degrees(number_slider_2))  # -> GeometryOut, InverseTransform
translate_to_world_origin_4 = TranslateToWorldOrigin(BboxIn=rectangle_2pt.Rectangle, GeometryIn=cull_pattern_5, Rotation=degrees(number_slider_2))  # -> GeometryOut, InverseTransform
list_item = ListItem(List=translate_to_world_origin_4.InverseTransform, Index=0, Wrap=True)
graft_tree_2 = GraftTree(Tree=translate_to_world_origin.GeometryOut, IncludeEmptyLists=True, IncludeNullItems=True)
move = Move(Geometry=translate_to_world_origin_4.GeometryOut, Motion=unit_z)  # -> Geometry, Transform
panel_6 = Panel(bounds_2)
inverse_transform = InverseTransform(Transform=list_item)
simplify_tree_2 = SimplifyTree(Tree=graft_tree_2, Front=False)
c_script = CSharpScript(pt=point, curvesIn=translate_to_world_origin.GeometryOut, dist=number_slider_3)  # -> out, A; inputs pt: Point3d, curvesIn: list of Curve, dist: Double
# ---------- c_script: C# ----------
    List<bool> cullPattern = new List<bool>(); 
    
    for( int i = 0; i < curvesIn.Count; ++i )
    {
    
      Point3d curveCenterPt = AreaMassProperties.Compute(curvesIn[i]).Centroid;
      
      // Computes the Euclidean distance from the input point to the centroid 
      // of eachs of the input curves, if the distance is smaller than that of 
      // dist's parameter we add a true, otherwise we add a false.
      if( pt.DistanceTo( curveCenterPt ) < dist )
      {
      
        cullPattern.Add( true );
      
      }
      
      else
      {
      
        cullPattern.Add( false );
      
      }
    
    }
    
    A = cullPattern;
# ---------- end c_script ----------
c_script_2 = CSharpScript(pt=point, curvesIn=translate_to_world_origin_3.GeometryOut, dist=number_slider_3)  # -> out, A; inputs pt: Point3d, curvesIn: list of Curve, dist: Double; same code as c_script
transform = Transform(Geometry=rectangle_2pt.Rectangle, Transform=inverse_transform)
area = Area(Geometry=simplify_tree_2)  # -> Area, Centroid
number_slider_4 = Slider(-200, range=-1000..-200)
patch = Patch(Curves=move.Geometry, Spans=20, Flexibility=1, Trim=True)
number_slider_5 = Slider(-200, range=-1000..-200)
unit_z_2 = UnitZ(Factor=number_slider_4)
multiplication_2 = Multiplication(A=number_slider_4, B=Slider(-1, range=-1..1))
unit_z_3 = UnitZ(Factor=number_slider_5)
multiplication_3 = Multiplication(A=number_slider_5, B=Slider(-1, range=-1..1))
unit_z_4 = UnitZ(Factor=multiplication_2)
unit_z_5 = UnitZ(Factor=multiplication_3)
move_2 = Move(Geometry=area.Centroid, Motion=unit_z_2)  # -> Geometry, Transform
move_3 = Move(Geometry=area.Centroid, Motion=unit_z_4)  # -> Geometry, Transform
move_4 = Move(Geometry=transform, Motion=unit_z_3)  # -> Geometry, Transform
move_5 = Move(Geometry=transform, Motion=unit_z_5)  # -> Geometry, Transform
line = Line(StartPoint=move_2.Geometry, EndPoint=move_3.Geometry)
loft = Loft(
    Curves=[move_4.Geometry, move_5.Geometry],
    Options={Adjust=False, Closed=False, LoftEnds=0, LoftSimp=0, LoftType=0, Rebuild=10, Refit=0.01})
split_brep = SplitBrep(Brep=patch, Cutter=loft)
list_item_2 = ListItem(List=split_brep, Index=Slider(1, range=0..1), Wrap=True)
surface_line = SurfaceLine(Surface=list_item_2, Line=line, LimitToFirst=False)  # -> Curves, simplify(Points), UVPoints, Normal
subtraction_2 = Subtraction(A=surface_line.Points, B=area.Centroid)
unit_z_6 = UnitZ(Factor=subtraction_2)
move_6 = Move(Geometry=simplify_tree_2, Motion=unit_z_6)  # -> Geometry, Transform
number = Number(simplify_tree)
unit_z_7 = UnitZ(Factor=number)
boundary_surfaces = BoundarySurfaces(Edges=move_6.Geometry)
project = Project(Curve=translate_to_world_origin_2.GeometryOut, Brep=list_item_2, Direction=Vector(0, 0, 1))
project_2 = Project(Curve=translate_to_world_origin_3.GeometryOut, Brep=list_item_2, Direction=Vector(0, 0, 1))
extrude = Extrude(Base=boundary_surfaces, Direction=unit_z_7)
flatten_tree_9 = FlattenTree(Tree=project_2, Path="{0}")
flatten_tree_10 = FlattenTree(Tree=extrude, Path="{0}")
cull_pattern_7 = CullPattern(List=flatten_tree_9, CullPattern=invert(c_script_2.A))
cull_pattern_8 = CullPattern(List=flatten_tree_10, CullPattern=invert(c_script.A))
cull_pattern_9 = CullPattern(List=flatten_tree_9, CullPattern=c_script_2.A)
cull_pattern_10 = CullPattern(List=flatten_tree_10, CullPattern=c_script.A)
number_slider_6 = Slider(5, range=0..10)
cull_pattern_11 = CullPattern(List=translate_to_world_origin_3.GeometryOut, CullPattern=c_script_2.A)
dom = ConstructDomain(DomainStart=0, DomainEnd=1)
boundary_surfaces_2 = BoundarySurfaces(Edges=cull_pattern_11, UseTasks=False)
c_script_3 = CSharpScript(
    genelist="GenePoolXCoord",
    count=number_slider_6,
    domain=dom,
    randomize=Button(),
    randomPercentage=Slider(1, range=0..1),
    Reference="C:\Program Files\Rhino 6\Plug-ins\Grasshopper\Components\GalapagosComponents.gha")  # -> out, A; inputs genelist: String, count: Int32, randomize: Boolean, randomPercentage: Double
# ---------- c_script_3: C# ----------
    GalapagosComponents.GalapagosGeneListObject GComp = null;

    GH_Document ghDocument = Component.OnPingDocument();

    if (ghDocument != null)
    {

      foreach (IGH_DocumentObject obj in ghDocument.Objects)
      {

        if (obj.ToString() == "GalapagosComponents.GalapagosGeneListObject")
        {

          if (obj.NickName == genelist)
          {
            GComp = (GalapagosComponents.GalapagosGeneListObject) obj;
          }

        }

      }
      if (GComp == null)
      {
        Print( "GenePool has not been found!" );
        return;
      }

      else
      {

        Print( "GenePool found!" );

      }

      GComp.Count = count;

      GComp.RemapToNewLimits(Convert.ToDecimal(domain.T0), Convert.ToDecimal(domain.T1));

      if( randomize )
      {
        GComp.Randomize(randomPercentage);

      }

      GComp.ExpireSolution(true);


    }

    else
    {

      Print( "No GH_Document" );

    }
# ---------- end c_script_3 ----------
# ...\Rhino 6\Plug-ins\Grasshopper\Components
c_script_4 = CSharpScript(
    genelist="GenePoolYCoord",
    count=number_slider_6,
    domain=dom,
    randomize=Button(),
    randomPercentage=Slider(1, range=0..1),
    Reference="C:\Program Files\Rhino 6\Plug-ins\Grasshopper\Components\GalapagosComponents.gha")  # -> out, A; inputs genelist: String, count: Int32, randomize: Boolean, randomPercentage: Double; same code as c_script_3
genepoolycoord = GenePool(Decimals=2, Maximum=1, Minimum=0, Value=[0.49, 0.21, 0.19, 0.82, 0.56])
genepoolxcoord = GenePool(Decimals=2, Maximum=1, Minimum=0, Value=[0.7, 0.12, 0.58, 0.75, 0.2])
construct_point = ConstructPoint(XCoordinate=genepoolxcoord, YCoordinate=genepoolycoord, ZCoordinate=0)
evaluate_surface = EvaluateSurface(Surface=reparameterize(boundary_surfaces_2), Point=construct_point)  # -> Point, Normal, UDirection, VDirection, Frame
construct_domain = ConstructDomain(DomainStart=Slider(7.717, range=0..100), DomainEnd=Slider(29.556, range=0..100))
construct_domain_2 = ConstructDomain(DomainStart=Slider(5.778, range=0..100), DomainEnd=Slider(25.302, range=0..100))
c_script_5 = CSharpScript(
    genelist="GenePoolXRectSize",
    count=number_slider_6,
    domain=construct_domain,
    randomize=Button(),
    randomPercentage=Slider(1, range=0..1),
    Reference="C:\Program Files\Rhino 6\Plug-ins\Grasshopper\Components\GalapagosComponents.gha")  # -> out, A; inputs genelist: String, count: Int32, randomize: Boolean, randomPercentage: Double; same code as c_script_3
c_script_6 = CSharpScript(
    genelist="GenePoolYRectSize",
    count=number_slider_6,
    domain=construct_domain_2,
    randomize=Button(),
    randomPercentage=Slider(1, range=0..1),
    Reference="C:\Program Files\Rhino 6\Plug-ins\Grasshopper\Components\GalapagosComponents.gha")  # -> out, A; inputs genelist: String, count: Int32, randomize: Boolean, randomPercentage: Double; same code as c_script_3
surface_closest_point = SurfaceClosestPoint(Point=evaluate_surface.Point, Surface=boundary_surfaces_2)  # -> Point, UVPoint, Distance
genepoolxrectsize = GenePool(Decimals=2, Maximum=29.556, Minimum=7.717, Value=[22.73631227, 7.946989469, 8.296973443, 27.70608471, 18.77649359])
genepoolyrectsize = GenePool(Decimals=2, Maximum=25.302, Minimum=5.778, Value=[5.828010246, 17.9204877, 15.73003893, 6.75820082, 8.718602459])
construct_domain_3 = ConstructDomain(DomainStart=0, DomainEnd=1)
panel_7 = Panel(construct_domain_3)
multiplication_4 = Multiplication(A=genepoolxrectsize, B=0.5)
multiplication_5 = Multiplication(A=genepoolyrectsize, B=0.5)
negative = Negative(Value=multiplication_4)
negative_2 = Negative(Value=multiplication_5)
construct_domain_4 = ConstructDomain(DomainStart=negative, DomainEnd=multiplication_4)
construct_domain_5 = ConstructDomain(DomainStart=negative_2, DomainEnd=multiplication_5)
rectangle = Rectangle(Plane=surface_closest_point.Point, XSize=construct_domain_4, YSize=construct_domain_5, Radius=0)  # -> Rectangle, Length
graft_tree_3 = GraftTree(Tree=rectangle.Rectangle, IncludeEmptyLists=True, IncludeNullItems=True)
construct_domain_6 = ConstructDomain(DomainStart=Slider(103.824, range=0..1000), DomainEnd=Slider(223.682, range=0..1000))
simplify_tree_3 = SimplifyTree(Tree=graft_tree_3, Front=False)
curve = Curve(simplify_tree_3)
c_script_7 = CSharpScript(
    genelist="GenePoolArea",
    count=number_slider_6,
    domain=construct_domain_6,
    randomize=Button(),
    randomPercentage=Slider(1, range=0..1),
    Reference="C:\Program Files\Rhino 6\Plug-ins\Grasshopper\Components\GalapagosComponents.gha")  # -> out, A; inputs genelist: String, count: Int32, randomize: Boolean, randomPercentage: Double; same code as c_script_3
offset_curve = OffsetCurve(Curve=simplify_tree_3, Distance=Slider(6.78, range=0..100), Plane=PlaneXY(0, 0, 0), Corners=1)
genepoolarea = GenePool(Decimals=2, Maximum=223.682, Minimum=103.824, Value=[132.6049696, 142.4525254, 130.57239, 187.3176103, 163.753])
curve_2 = Curve(offset_curve)
area_2 = Area(Geometry=simplify_tree_3)  # -> Area, Centroid
curve_3 = Curve(cull_pattern_11)
flatten_tree_11 = FlattenTree(Tree=[offset_curve, curve_3], Path="{0}")
panel_8 = Panel(area_2.Area)
collision_many_many = CollisionManyMany(Colliders=flatten_tree_11)  # -> Collision, Indices
flatten_tree_12 = FlattenTree(Tree=area_2.Area, Path="{0}")
integer = Integer(collision_many_many.Collision)
panel_9 = Panel(collision_many_many.Collision)
panel_10 = Panel(integer)
expression = Expression(x=flatten_tree_12, y=genepoolarea, Expression="Abs( x - y )")
panel_11 = Panel(expression)
mass_addition = MassAddition(Input=expression)  # -> Result, PartialResults
multiplication_6 = Multiplication(A=integer, B=Slider(10, range=0..10))
panel_13 = Panel(mass_addition.Result)
panel_14 = Panel(multiplication_6)
mass_addition_2 = MassAddition(Input=flatten([multiplication_6, mass_addition.Result]))  # -> Result, PartialResults
galapagos = Galapagos(fitness=mass_addition_2, gene=[genepoolxrectsize, genepoolyrectsize, genepoolxcoord, genepoolycoord])
