# Grasshopper definition GISWorkshop_2.gh (Grasshopper 1.0.7)
# plug-ins: Weaverbird, GHopperGIS

run_gdal_and_ogr = RunGDALAndOGR()
panel = Panel("""4.487540
-73.467917""")
panel_2 = Panel("""4.470376
-73.488945""")
list_item = ListItem(List=panel_2, Index=0, Wrap=True)  # -> Item, Item1
list_item_2 = ListItem(List=panel, Index=0, Wrap=True)  # -> Item, Item1
construct_domain² = ConstructDomain²(UMin=list_item.Item, UMax=list_item.Item1, VMin=list_item_2.Item, VMax=list_item_2.Item1)
stream_gate = StreamGate(Stream="D:\SSS\PerformanceNetwork\Data\Topography.tif", Gate=Toggle(False))  # -> Target0, Target1
download_topography = DownloadTopography(OutputPaths=stream_gate.Target1, _2DDomain=construct_domain², DataSource=1)
read_raster_file_info = ReadRasterFileInfo(PathToFile=stream_gate.Target1)  # -> DataSet, CacheSize
get_coordinates_from_raster_file = GetCoordinatesFromRasterFile(PathToFile=stream_gate.Target1)  # -> Latitude, Longitude, UCount, VCount, Projection
bounds = Bounds(Numbers=read_raster_file_info.DataSet)
deconstruct_domain = DeconstructDomain(Domain=bounds)  # -> Start, End
subtraction = Subtraction(A=read_raster_file_info.DataSet, B=deconstruct_domain.Start)
bounds_2 = Bounds(Numbers=subtraction)
reproject_from_coords = ReprojectFromCoords(
    XCoordinate=get_coordinates_from_raster_file.Latitude,
    YCoordinate=get_coordinates_from_raster_file.Longitude,
    ZCoordinate=subtraction,
    InputEPSG=get_coordinates_from_raster_file.Projection,
    OutputEPSG=Slider(3857, range=0..10000))
mesh_from_points = MeshFromPoints(
    GridOfPoints=reproject_from_coords,
    UParameter=get_coordinates_from_raster_file.UCount,
    VParameter=get_coordinates_from_raster_file.VCount,
    Triangles=Toggle(True))
subdivide_point_grid = SubdividePointGrid(
    PointsIn=reproject_from_coords,
    UParameter=get_coordinates_from_raster_file.UCount,
    VParameter=get_coordinates_from_raster_file.VCount,
    Iterations=Slider(2, range=0..10))  # -> PointsOut, UOut, VOut
mesh_from_points_2 = MeshFromPoints(
    GridOfPoints=subdivide_point_grid.PointsOut,
    UParameter=subdivide_point_grid.UOut,
    VParameter=subdivide_point_grid.VOut,
    Triangles=Toggle(True))
bounding_box = BoundingBox(Content=mesh_from_points_2, Plane=PlaneXY(0, 0, 0))  # -> Box, Box_2
translate_to_world_origin = TranslateToWorldOrigin(BboxIn=bounding_box.Box, GeometryIn=mesh_from_points_2, UseTasks=False)  # -> GeometryOut, InverseTransform
weaverbird_s_laplacian_smoothing = WeaverbirdsLaplacianSmoothing(MeshCurves=translate_to_world_origin.GeometryOut, Level=1, SmoothNakedEdges=1, Thin=1)
U = Integer(subdivide_point_grid.UOut)
V = Integer(subdivide_point_grid.VOut)
live_erosion = LiveErosion(
    Run=Toggle(False),
    Reset=Button(),
    MeshIn=weaverbird_s_laplacian_smoothing,
    UParameter=U,
    VParameter=V,
    InitialSediment=Slider(1, range=0..1),
    Sediment=Slider(1, range=0..1),
    Erosion=Slider(0.7, range=0..1),
    Deposition=Slider(0.7, range=0..1),
    Visualize=Toggle(True),
    ParticlesPerIteration=Slider(425, range=0..1000),
    RandomSeed=Slider(5440, range=0..10000),
    MaximumIterations=Slider(1000, range=0..1000),
    ParallelComputation=Toggle(True))  # -> ErodedMesh, NumberOfIterations, FlowLines
mesh = Mesh(weaverbird_s_laplacian_smoothing)
